# Grasshopper definition Elastica.gh (Grasshopper 1.0.7)
# plug-ins: Eagle

pt = ConstructPoint(XCoordinate=0, YCoordinate=0, ZCoordinate=0)
pt_2 = ConstructPoint(XCoordinate=0, YCoordinate=0, ZCoordinate="1")
pt_3 = ConstructPoint(XCoordinate=Slider(1.6, range=-100..100), YCoordinate=Slider(-6.4, range=-100..100), ZCoordinate=0)
ln = Line(StartPoint=pt, EndPoint=pt_3)
pl_3pt = Plane3Pt(PointA=pt, PointB=pt_3, PointC=pt_2)
curvepoint = PointOnCurve(ln, parameter=0.5)
elastica = Elastica(StartPointA=pt, StartPointB=pt_3, WorkingPlane=pl_3pt, Length=Slider(23.2, range=10..1000))  # -> Pts, C, L, W, H, A, F
crv = Curve(elastica.C)
rad = Radians(Degrees=Slider(270, range=0..360))
xy = XYPlane(Origin=curvepoint)
rotate = Rotate(Geometry=ln, Angle=rad, Plane=xy)  # -> Geometry, Transform
curvepoint_2 = PointOnCurve(rotate.Geometry, parameter=0.5)
eval = EvaluateCurve(Curve=reparameterize(crv), Parameter=Slider(0.67, range=0..1))  # -> Point, Tangent, Angle
scale = Scale(Geometry=rotate.Geometry, Center=curvepoint_2, Factor=Slider(1.5, range=0..10))  # -> Geometry, Transform
ln_2 = Line(StartPoint=eval.Point, EndPoint=curvepoint)
end = EndPoints(Curve=scale.Geometry)  # -> Start, End
hull = ConvexHull(Points=[pt, pt_3, end.Start, end.End], Plane=PlaneXY(0, 0, 0))  # -> Hull, HullZ, Indices
explode = Explode(Curve=hull.Hull, Recursive=True)  # -> Segments, Vertices
len = Length(Curve=scale.Geometry)
len_2 = Length(Curve=ln_2)
pl_3pt_2 = Plane3Pt(PointA=end.Start, PointB=end.End, PointC=eval.Point)
elastica_2 = Elastica(StartPointA=end.Start, StartPointB=end.End, WorkingPlane=pl_3pt_2, Height=len_2)  # -> Pts, C, L, W, H, A, F
panel = Panel(elastica_2.F)
crv_2 = Curve(elastica_2.C)
ccx = CurveCurve(CurveA=crv, CurveB=crv_2)  # -> Points, ParamsA, ParamsB
ln_3 = Line(StartPoint=ccx.Points, EndPoint=eval.Point)
len_3 = Length(Curve=ln_3)
panel_2 = Panel(len_3)
