# Grasshopper definition XYZ_ReadTemplate.gh (Grasshopper 1.0.7)
# plug-ins: AntFarmGrasshopper

path = FilePath("D:\coding\Eagle\TestData\XYZ\")
fif = FilesInFolder(Path=path, Recursive=False, AsMesh=Toggle(True), PointSkip="50")
viewer = ParamViewer(fif)
item = ListItem(List=flatten(fif), Index=Slider(17, range=0..20), Wrap=True)  # -> Item, Item1, Item2
weld = WeldMesh(Mesh=[item.Item, item.Item1, item.Item2], Angle=3.141592654)
demesh = DeconstructMesh(Mesh=flatten(fif))  # -> simplify(Vertices), Faces, Colours, Normals
index = ItemIndex(List=viewer, Item=viewer)
lng = ListLength(List=index)
geo = Geometry(weld)
dom = ConstructDomain(DomainStart=0, DomainEnd=Slider(0.64, range=-0.1..0.95))
range = Range(Domain=dom, Steps=lng)
cull_i = CullIndex(List=range, Indices=lng, Wrap=True)
pt = Point(demesh.Vertices)
hsl = ColourHSL(Alpha=1, Hue=cull_i, Saturation=1, Luminance=0.5)
custom_display = CustomDisplay(Geoemtry=fif, Color=hsl)
